# Dynamo graph Classificaçao de Vaos - Schedules v3.dyn "Schedules Vaos v3" (Dynamo 2.0.2.6826)

# group: Vãos a classificar
selecionar_janelas_da_fachada_a = DSModelElementsSelection()  # "Selecionar janelas da fachada a classificar"; 189 picked in the model
selecionar_origem_mulion_da = DSModelElementSelection()  # "Selecionar Origem (mulion da janela mais à esquerda"; 1 picked in the model

code_block = CodeBlock { "Type"; }
getParameterValueByName = Element.GetParameterValueByName(element=selecionar_janelas_da_fachada_a, parameterName=code_block)
string_from_object = FromObject(obj=getParameterValueByName)
string = StringInput("Janela")
string_2 = StringInput("Porta")
string_3 = StringInput("Grelha")
code_block_2 = CodeBlock(a=string_from_object, str1=string, str2=string_2, str3=string_3)
# ---------- code_block_2.designscript (4 lines) ----------
String.Contains(a,str1,
true) || String.Contains(a,str2,
true)|| String.Contains(a,str3,
true);
# ----------------------------------------
filterByBoolMask = List.FilterByBoolMask(list=selecionar_janelas_da_fachada_a, mask=code_block_2)
boundingBox = Element.BoundingBox(element=filterByBoolMask.in)
properties = Custom[BoundingBox.Properties](boundingBox=boundingBox)  # Retrieves the centroid, width, depth and height of a given bounding box
boundingBox_2 = Element.BoundingBox(element=selecionar_origem_mulion_da)
properties_2 = Custom[BoundingBox.Properties](boundingBox=boundingBox_2)
byStartPointEndPoint = Line.ByStartPointEndPoint(startPoint=properties.Centroid, endPoint=properties_2.Centroid, lacing=Longest)
code_block_3 = CodeBlock { 0; }
replaceNulls = Lists.Manage.ReplaceNulls(Data=byStartPointEndPoint, ReplaceWith=code_block_3)
length = Curve.Length(curve=replaceNulls)
code_block_4 = CodeBlock { 0; }
replaceNulls_2 = Lists.Manage.ReplaceNulls(Data=length, ReplaceWith=code_block_4)
sortIndexByValue = List.SortIndexByValue(list=replaceNulls_2)
getItemAtIndex = List.GetItemAtIndex(list=filterByBoolMask.in, index=sortIndexByValue)
code_block_5 = CodeBlock { "Mark"; }

# group: Info dos vãos
pavilhão = StringInput("Ed6")
fachada = StringInput("N")
vãos_da_fachada_já_numerados = DoubleInput(0)

string_4 = StringInput(".")
concat = String.Concat(string0=pavilhão, string1=string_4, string2=fachada, string3=string_4)
count = List.Count(list=getItemAtIndex)
code_block_6 = CodeBlock(a=count) { 1..a; }
add = vãos_da_fachada_já_numerados + code_block_6
code_block_7 = CodeBlock(a=concat, b=add) { a+b; }
setParameterByName = Element.SetParameterByName(element=getItemAtIndex, parameterName=code_block_5, value=code_block_7)
watch = Watch(setParameterByName)
