# Dynamo graph Copia Type que contem Janelas para Comments.dyn (Dynamo 2.0.2.6826)

code_block = CodeBlock { "Mark"; }
pavilhão = StringInput("Pav3")
string = StringInput(".")
fachada = StringInput("N")
concat = String.Concat(string0=pavilhão, string1=string, string2=fachada, string3=string)
vãos_dos_pisos_acima_já = CodeBlock { 16; }  # "Vãos dos pisos acima, já classificados"
add = vãos_dos_pisos_acima_já + _  # unwired: y
code_block_2 = CodeBlock(a=concat, b=add) { a+b; }
setParameterByName = Element.SetParameterByName(parameterName=code_block, value=code_block_2)  # unwired: element
code_block_3 = CodeBlock { "Comments"; }
string_2 = StringInput("Janela de ")
folhas_da_janela = StringInput("oito")
string_3 = StringInput(" folhas. Caixilharia em alumínio")
concat_2 = String.Concat(string0=string_2, string1=folhas_da_janela, string2=string_3)
setParameterByName_2 = Element.SetParameterByName(parameterName=code_block_3, value=concat_2)  # unwired: element
categories = Categories(index=604)
all_elements_of_category = ElementsOfCategory(Category=categories)
code_block_4 = CodeBlock { "Type"; }
getParameterValueByName = Element.GetParameterValueByName(element=all_elements_of_category, parameterName=code_block_4)
string_from_object = FromObject(obj=getParameterValueByName)
string_4 = StringInput("Porta")
boolean = BoolSelector(true)
contains = String.Contains(str=string_from_object, searchFor=string_4, ignoreCase=boolean)
filterByBoolMask = List.FilterByBoolMask(list=all_elements_of_category, mask=contains)
code_block_5 = CodeBlock { "Comments"; }
filterByBoolMask_2 = List.FilterByBoolMask(list=string_from_object, mask=contains)
setParameterByName_3 = Element.SetParameterByName(element=filterByBoolMask.in, parameterName=code_block_5, value=filterByBoolMask_2.in)
