# Dynamo graph Copy Uniformat II - 2010.dyn "Copy Uniformat II - 2020" (Dynamo 2.1.0.7500)

# note: Structural Trusses not included due to API issue
# Curtain Panels removed due to error with testing
category_list = CodeBlock()
# ---------- category_list.designscript (40 lines) ----------
["Air Terminals",
"Cable Tray Fittings","Cable Tray Runs","Cable Trays",
"Casework",
"Ceilings",
"Columns",
"Communication Devices",
"Conduit Fittings","Conduit Runs","Conduits",
"Curtain Wall Mullions",
"Data Devices",
"Doors",
"Duct Accessories","Duct Fittings","Duct Insulations",
"Duct Linings","Duct Systems","Ducts",
"Electrical Equipment",
"Electrical Fixtures",
"Fire Alarm Devices",
"Flex Ducts","Flex Pipes","Floors",
"Furniture","Furniture Systems",
"Generic Models","Lighting Devices","Lighting Fixtures",
"MEP Fabrication Containment","MEP Fabrication Ductwork",
"MEP Fabrication Hangers","MEP Fabrication Pipework",
"Mechanical Equipment",
"Nurse Call Devices",
"Pipe Accessories","Pipe Fittings","Pipe Insulations",
"Pipes","Piping Systems",
"Planting","Plumbing Fixtures",
"Railings",
"Ramps",
"Roofs",
"Security Devices",
"Site",
"Specialty Equipment",
"Sprinklers",
"Stairs",
"Structural Area Reinforcement","Structural Beam Systems",
"Structural Columns","Structural Connections",
"Structural Fabric Reinforcement","Structural Foundations",
"Structural Framing","Structural Path Reinforcement",
"Structural Rebar","Structural Stiffeners",
"Telephone Devices",
"Topography","Walls","Windows"];
# ----------------------------------------
byName = Category.ByName(name=category_list)
code_block = CodeBlock { toggle: bool = true; }
code_block_2 = CodeBlock()
# ---------- code_block_2.designscript (2 lines) ----------
/* Use only if you want to query a linked model*/
docOrRevitLinkInstance: var = null;
# ----------------------------------------
# note: Code block from Clockwork Package - expanded to allow easier sharing
python_script = Python(IN[0]=byName, IN[1]=code_block, IN[2]=code_block_2)
# ---------- python_script.python (22 lines) ----------
import System
import clr
clr.AddReference('RevitAPI')
from Autodesk.Revit.DB import *

clr.AddReference("RevitServices")
import RevitServices
from RevitServices.Persistence import DocumentManager

def ElementTypesByCategory(cat, doc):
	bic = System.Enum.ToObject(BuiltInCategory, cat.Id)
	collector = FilteredElementCollector(doc).OfCategory(bic).WhereElementIsElementType()
	return collector.ToElements()

inputdoc = UnwrapElement(IN[2])
if not inputdoc: doc = DocumentManager.Instance.CurrentDBDocument
elif inputdoc.GetType().ToString() == "Autodesk.Revit.DB.RevitLinkInstance": doc = inputdoc.GetLinkDocument()
elif inputdoc.GetType().ToString() == "Autodesk.Revit.DB.Document": doc = inputdoc
else: doc = DocumentManager.Instance.CurrentDBDocument

if isinstance(IN[0], list): OUT = [ElementTypesByCategory(x, doc) for x in IN[0]]
else: OUT = ElementTypesByCategory(IN[0], doc)
# ----------------------------------------
flatten = List.Flatten(list=python_script)

# group: Update Number
new_parameter_name = CodeBlock { "Classification.UniFormat.2010.Number"; }
original_parameter_name = CodeBlock { "Classification.UniFormat.II.Number"; }
getParameterValueByName = Element.GetParameterValueByName(element=flatten, parameterName=original_parameter_name)
setParameterByName = Element.SetParameterByName(element=flatten, parameterName=new_parameter_name, value=getParameterValueByName)

# group: Update Description
new_parameter_name_2 = CodeBlock { "Classification.UniFormat.2010.Description"; }
original_parameter_name_2 = CodeBlock { "Classification.UniFormat.II.Description"; }
getParameterValueByName_2 = Element.GetParameterValueByName(element=flatten, parameterName=original_parameter_name_2)
setParameterByName_2 = Element.SetParameterByName(element=flatten, parameterName=new_parameter_name_2, value=getParameterValueByName_2)
