# Dynamo graph Create file name from model file path.dyn "Parametros Revit para XML" (Dynamo 2.2.1.5175)

# group: Create Name of the File to Create (same as Revit file bit with XML extension);
current = Document.Current()
filePath = Document.FilePath(document=current)
string = StringInput("https://wrw.is/the-many-ids-of-a-revit-element-and-how-to-work-with-them-elementid-uniqueid-dwf-guid-ifcguid/")  # graph input
split = String.Split(str=filePath, separator0=string)
lastItem = List.LastItem(list=split)
string_2 = StringInput(".")  # graph input
split_2 = String.Split(str=lastItem, separator0=string_2)
firstItem = List.FirstItem(list=split_2)
string_3 = StringInput(".rvt")  # graph input
split_3 = String.Split(str=filePath, separator0=string_3)
firstItem_2 = List.FirstItem(list=split_3)
watch = Watch(firstItem_2)
string_4 = StringInput(".xml")  # graph input
concat = String.Concat(string0=watch, string1=string_4)

watch_2 = Watch(concat)
