# Dynamo graph CriaArtigoDoMQT(1.2_001)_paraLimsen&GET.dyn "List-Renumber" (Dynamo 2.16.1.2727)

# group: Read me
# note: Feito por Ricardo Resende / Sébastien Roux
# note: Utiliza o archi-lab.net

# group: Apanha elementos a analisar
code_block = CodeBlock { ["Mechanical Equipment","Duct Accessories"]; }
byName = Category.ByName(name=code_block)
all_elements_of_category = ElementsOfCategory(Category=byName)
flatten = List.Flatten(list=all_elements_of_category)

watch = Watch(flatten)

# group: Apanha parametros MQT 1 e MQT 2
code_block_2 = CodeBlock(t1=watch)
# ---------- code_block_2.designscript (2 lines) ----------
MQT1 = Revit.Element.GetParameterValueByName(t1, "MQT Nivel 1");
MQT2 = Revit.Element.GetParameterValueByName(t1, "MQT Nivel 2");
# ----------------------------------------

# group: Trata dos nulls E monta parametro Artigo: 1.2
string_from_object = FromObject(object=code_block_2.MQT1)
code_block_3 = CodeBlock { "null"; "-"; }
replace = String.Replace(string=string_from_object, searchFor=code_block_3.out0, replaceWith=code_block_3.out1)
# note: Se string estiver vazio escreve hífen
python_script = Python(IN[0]=replace)  # CPython3
# ---------- python_script.python (22 lines) ----------
# Import the necessary Dynamo libraries
import clr

# The input port for the list of strings
input_list = IN[0]

def replace_empty_strings_with_hyphen(input_list):
    # Create a new list to store the modified strings
    modified_list = []
    for string in input_list:
        # Check if the string is empty, and replace it with a hyphen if it is
        if not string:
            modified_list.append("-")
        else:
            modified_list.append(string)
    return modified_list

# Call the function and pass the input list
modified_list = replace_empty_strings_with_hyphen(input_list)

# Output the modified list
OUT = modified_list
# ----------------------------------------
code_block_4 = CodeBlock { "."; }
split = String.Split(string=python_script, separator0=code_block_4)
code_block_5 = CodeBlock { 0; }
getItemAtIndex = List.GetItemAtIndex(list=split@L2, index=code_block_5)
# note: apanha # MQT
string_from_object_2 = FromObject(object=getItemAtIndex)
code_block_6 = CodeBlock { "null"; "-"; }
# note: Volta a substituir nulls (n deve ser preciso)
replace_2 = String.Replace(string=string_from_object_2, searchFor=code_block_6.out0, replaceWith=code_block_6.out1)
string_from_object_3 = FromObject(object=code_block_2.MQT2)
replace_3 = String.Replace(string=string_from_object_3, searchFor=code_block_3.out0, replaceWith=code_block_3.out1)
python_script_2 = Python(IN[0]=replace_3)  # CPython3; same code as python_script
split_2 = String.Split(string=python_script_2, separator0=code_block_4)
getItemAtIndex_2 = List.GetItemAtIndex(list=split_2@L2, index=code_block_5)
string_from_object_4 = FromObject(object=getItemAtIndex_2)
replace_4 = String.Replace(string=string_from_object_4, searchFor=code_block_6.out0, replaceWith=code_block_6.out1)
code_block_7 = CodeBlock(str2=replace_2, str3=replace_4) { t1 = str2 + "."; t2 = t1 + str3; }

# group: Ordena lista de Artigo por ordem alfabetica e dá tb a posição inicial
python_script_3 = Python(IN[0]=code_block_7.t2)  # CPython3
# ---------- python_script_3.python (25 lines) ----------
# Import the necessary Dynamo libraries
import clr

# The input port for the list of strings
input_list = IN[0]

def sort_strings_with_indexes(input_list):
    # Create a list of tuples (string, index) to store the original order
    string_with_indexes = [(s, i) for i, s in enumerate(input_list)]
    # Sort the list of tuples based on the strings
    sorted_with_indexes = sorted(string_with_indexes, key=lambda x: x[0])
    
    # Extract the sorted strings and the original indexes
    sorted_strings = [item[0] for item in sorted_with_indexes]
    original_indexes = [item[1] for item in sorted_with_indexes]
    
    return sorted_strings, original_indexes


# Call the sorting function and pass the input list
sorted_strings, original_indexes = sort_strings_with_indexes(input_list)


# Output the sorted list and the original indexes
OUT = sorted_strings, original_indexes
# ----------------------------------------
code_block_8 = CodeBlock(ParametroOrdenado=python_script_3, OrdemOriginal=python_script_3) { ParametroOrdenado[0]; OrdemOriginal[1]; }

# group: Ordena elementos para a mesma ordem dos Artigos
# note: Elementos Originais
watch_2 = Watch(watch)
getItemAtIndex_3 = List.GetItemAtIndex(list=watch_2, index=code_block_8.out1)

# group: Adiciona número 001...002 a cada artigo diferente
python_script_4 = Python(IN[0]=code_block_8.out0)  # CPython3
# ---------- python_script_4.python (31 lines) ----------
# Import the necessary Dynamo libraries
import clr

# The input port for the list of strings
input_list = IN[0]

def add_number_to_strings(input_list):
    result_list = []
    previous_string = None
    number = 1
    
    for string in input_list:
        if "-" in string:
            result_list.append(string)
        else:
            if string != previous_string:
                number = 1
                previous_string = string
                
            formatted_number = f"{number:03d}"  # Format the number as 3-digit, e.g., 001, 002, etc.
            result_list.append(f"{string}_{formatted_number}")
            number += 1
            
    return result_list

# Call the function and pass the input list
result_list = add_number_to_strings(input_list)


# Output the modified list
OUT = result_list
# ----------------------------------------
code_block_9 = CodeBlock { "Artigo"; }
getParameterValueByName = Element.GetParameterValueByName(element=getItemAtIndex_3, parameterName=code_block_9)

# group: Actualiza parâmetro Artigo nos elementos
code_block_10 = CodeBlock { "Artigo"; }
setParameterByName = Element.SetParameterByName(element=getItemAtIndex_3, parameterName=code_block_10, value=python_script_4)

# group: Grupo de teste
shuffle = List.Shuffle(list=flatten)
code_block_11 = CodeBlock { 10; }
takeItems = List.TakeItems(list=shuffle, amount=code_block_11)

artigo = Watch(python_script_4)
