# Dynamo custom node Custom Node - Points.Coordinates_V1.dyf "Points.Coordinates_V1" (Dynamo 2.0.1.5055)
# category: RResende
# Custom Node for generation of tables with pixel  coordinates of points

# note: Lista com coordenadas x,y,z a transformar
var_var_var = Input(: var[]..[]: var[]..[]: var[]..[]: var[]..[])
X = Point.X(point=var_var_var)
# note: Lista com coordenadas x,y,z mínimas do projecto
var_var_var_2 = Input(: var[]..[]: var[]..[]: var[]..[]: var[]..[])
code_block = CodeBlock { 0; }
getItemAtIndex = List.GetItemAtIndex(list=var_var_var_2, index=code_block)
Y = Point.Y(point=var_var_var)
code_block_2 = CodeBlock { 1; }
getItemAtIndex_2 = List.GetItemAtIndex(list=var_var_var_2, index=code_block_2)
Z = Point.Z(point=var_var_var)
code_block_3 = CodeBlock { 2; }
getItemAtIndex_3 = List.GetItemAtIndex(list=var_var_var_2, index=code_block_3)

# group: Puxa coordenadas para a origem (0,0,0)
code_block_4 = CodeBlock(x=X, delta_x=getItemAtIndex, y=Y, delta_y=getItemAtIndex_2, z=Z, delta_z=getItemAtIndex_3) { x-delta_x; y-delta_y; z-delta_z; }

# group: Arredonda à unidade
round = Math.Round(number=code_block_4.out0)
ceiling = Math.Ceiling(number=round)
round_2 = Math.Round(number=code_block_4.out1)
ceiling_2 = Math.Ceiling(number=round_2)
round_3 = Math.Round(number=code_block_4.out2)
ceiling_3 = Math.Ceiling(number=round_3)

# note: Tamanho da Imagem Final
var_var_var_3 = Input(: var[]..[]: var[]..[]: var[]..[]: var[]..[])
# note: Passa a origem do Y para cima (como uma matriz. Usa a altura da imagem que vem de trás
sub = var_var_var_3 - ceiling_2
constrói_string_formatada_xx_yyy = Python(IN[0]=ceiling, IN[1]=sub, IN[2]=ceiling_3)  # "Constrói string formatada (xx,yyy,zzz) [Python Script]"
# ---------- constrói_string_formatada_xx_yyy.python (21 lines) ----------
import clr
clr.AddReference('ProtoGeometry')
from Autodesk.DesignScript.Geometry import *
#The inputs to this node will be stored as a list in the IN variables.
dataEnteringNode = IN

coord_x = IN[0]
coord_y = IN[1]
coord_z = IN[2]

i = 0

OUT = list()


for x in coord_x:
	aa = '(' + str(coord_x[i]) + ';' + str(coord_y[i]) + ';' + str(coord_z[i]) + ')'
	i=i+1
	type(aa)
	OUT.append(aa)
#Assign your output to the OUT variable.
# ----------------------------------------
code_block_5 = CodeBlock(OUT=constrói_string_formatada_xx_yyy) { OUT; }
Output = Output(code_block_5)  # ""
