# Dynamo graph Duplicate Levels from Linked File.dyn "Copia Levels" (Dynamo 2.5.0.7460)
# packages: spring nodes 203.2.0

select_model_element = DSModelElementSelection()  # 1 picked in the model
categories = Categories("OST_Levels")
ꟿ_collect_linkedinstanceelements = Custom[ꟿ Collect.LinkedInstanceElements](linkInstance=select_model_element, CategoryOrType=categories)  # package spring nodes; Extract elements by category from the selected linked instances. The transform CS can be used to get the exact location of the elements in the host file. If an error occurs or the linked document is unloaded, an error will be returned in the elements output and the appropriate transform will be a null. You can use those nulls to filter out the errors.
watch = Watch(ꟿ_collect_linkedinstanceelements.elements)
flatten = List.Flatten(list=watch)
elevation = Level.Elevation(level=flatten)
code_block = CodeBlock { -700; }
add = elevation + code_block
name = Level.Name(level=flatten)
code_block_2 = CodeBlock { "_struct"; }
add_2 = name + code_block_2
byElevationAndName = Level.ByElevationAndName(elevation=add, name=add_2)
watch_2 = Watch(byElevationAndName)
code_block_3 = CodeBlock { 0; }
getItemAtIndex = List.GetItemAtIndex(list=flatten, index=code_block_3)
parameters = Element.Parameters(element=getItemAtIndex)
watch_3 = Watch(parameters)
