# Dynamo graph Excel+CSV_ExportWithProjectName.dyn (Dynamo 2.17.1.4055)

# group: Nome do ficheiro
# note: Nome = ao ficheiro
current = Document.Current()
filePath = Document.FilePath(document=current)
code_block = CodeBlock { -1; }
fileName = FileSystem.FileName(path=filePath, withExtension=code_block)
code_block_2 = CodeBlock { ".rvt"; ""; }
replace = String.Replace(string=filePath, searchFor=fileName, replaceWith=code_block_2.out1)
replace_2 = String.Replace(string=fileName, searchFor=code_block_2.out0, replaceWith=code_block_2.out1)
watch = Watch(replace_2)

code_block_3 = CodeBlock(dirPath=replace, file=watch) { dirPath+file+".csv"; }

# group: Forma lista única
list_create = List.Create()  # unwired: item0
transpose = List.Transpose(lists=list_create)

code_block_4 = CodeBlock(dirPath=replace, file=watch) { dirPath+file+".xls"; }

# group: Exportação para Excel e CSV
exportCSV = Data.ExportCSV(filePath=code_block_3, data=transpose)
code_block_5 = CodeBlock { "Elementos na Vista"; 0; }
code_block_6 = CodeBlock { 1; -1; }
exportToExcel = Data.ExportToExcel(filePath=code_block_4, sheetName=code_block_5.out0, startRow=code_block_5.out1, startColumn=code_block_5.out1, data=transpose, overWrite=code_block_6.out0, writeAsString=code_block_6.out1)
