# Dynamo graph GetInternalIdFromExternalId V2dyn.dyn (Dynamo 3.3.0.6316)

# group: Para apanhar os IFC GUID
file_path = Filename(".\Apanha Ids.txt")
select_model_elements = DSModelElementsSelection()  # 31 picked in the model; frozen
code_block = CodeBlock { "IfcGUID"; }
getParameterValueByName = Element.GetParameterValueByName(element=select_model_elements, parameterName=code_block)
string_from_array = FromArray(array=getParameterValueByName)
writeText = FileSystem.WriteText(filePath=file_path, text=string_from_array)

# group: Dicionário IfcGUID-Element
all_elements_in_active_view = ElementsInView()
code_block_2 = CodeBlock { "IfcGUID"; }
getParameterValueByName_2 = Element.GetParameterValueByName(element=all_elements_in_active_view, parameterName=code_block_2)
byKeysValues = DesignScript.Builtin.Dictionary.ByKeysValues(keys=getParameterValueByName_2, values=all_elements_in_active_view)

# group: Apanha IFC GUID do Excel
file_path_2 = Filename(".\External Id.xlsx")
file_from_path = FileObject(path=file_path_2)
code_block_3 = CodeBlock { "Sheet1"; }
importExcel = Data.ImportExcel(file=file_from_path, sheetName=code_block_3)
flatten = List.Flatten(list=importExcel)

# group: Devolve Elementos
valueAtKey = DesignScript.Builtin.Dictionary.ValueAtKey(dictionary=byKeysValues, key=flatten)
color_palette = ColorPalette({R: 255, G: 255, B: 0, A: 255})
overrideColorInView = Element.OverrideColorInView(element=valueAtKey, color=color_palette)

# group: Internal Id para Texto
file_path_3 = Filename(".\Devolve Internal Id.txt")
id = Element.Id(element=overrideColorInView)
string_from_array_2 = FromArray(array=id)
writeText_2 = FileSystem.WriteText(filePath=file_path_3, text=string_from_array_2)
