# Dynamo graph ProgressStatus.dyn "EN_iMBIM_1802_Nacci,Francesco_ProgressStatus" (Dynamo 2.0.2.6826)

# group: Credits for export-to-excel routine
# note: Copyright (c) 2015, AECOM
# Written by: Matthew Anderle & Chris Williams
# Adapted from "20 Practical Uses of Dynamo for Revit to Improve Team ... - Autodesk University 2016"
# Link
# http://au.autodesk.com/au-online/classes-on-demand/class-catalog/2016/dynamo-studio/ar20786
# this routine has been configured and adapted to the use of this exercise by Francesco Nacci

# group: File Creation
# note: this part of the script creates the file as the base of progress alignment. not needed if the progress file exists.

# group: Progress reading and input into Revit Elements
# note: this part of the script reads the progress information calculated by another program and set the project parameter accordingly

# group: Preliminary Actions
# note: 1) Create Project Parameters under Text Category for all the project Elements:
# 	Construction Progress
# 	Construction Status
# 	Standard Manhours
# 2) Create new 3D view and name it "Construction Status"
# 3) set Construction Status view active
# 4) run the script

# group: Software used
# note: Autodesk Revit 2018
# Microsoft Excel
# Dynamo 2.0.2
# Springs Nodes for Dynamo 110.0.2

# group: User Selection
file_path = Filename(".\4.4.ProgressInfoExport.xlsx")  # graph input
worksheet_name_can_be_new = StringInput("Column List")  # graph input
categories = Categories(index=589)  # graph input
categories_2 = Categories(index=399)  # graph input
categories_3 = Categories(index=206)  # graph input
categories_4 = Categories(index=496)  # graph input
categories_5 = Categories(index=519)  # graph input
categories_6 = Categories(index=472)  # graph input
categories_7 = Categories(index=363)  # graph input

list_create = List.Create(item0=categories, item1=categories_2, item2=categories_3, item3=categories_4, item4=categories_5, item5=categories_6, item6=categories_7)  # frozen
watch = Watch(list_create)

# group: Get All Elements of a Category
all_elements_of_category = ElementsOfCategory(Category=watch)
code_block = CodeBlock { 1; }
flatten = List.Flatten(list=all_elements_of_category, amt=code_block)
watch_2 = Watch(flatten)
# note: Just for visualization
geometry = Element.Geometry(element=all_elements_of_category)

# group: Create Values Column
getCategory = Element.GetCategory(element=watch_2)
name = Family.Name(family=watch_2)
id = Element.Id(element=watch_2)
uniqueId = Element.UniqueId(element=watch_2)
code_block_2 = CodeBlock { "Area"; }
getParameterValueByName = Element.GetParameterValueByName(element=watch_2, parameterName=code_block_2)
code_block_3 = CodeBlock { "Standard Manhours"; }
getParameterValueByName_2 = Element.GetParameterValueByName(element=watch_2, parameterName=code_block_3)
code_block_4 = CodeBlock { "Construction Progress"; }
getParameterValueByName_3 = Element.GetParameterValueByName(element=watch_2, parameterName=code_block_4)
code_block_5 = CodeBlock { "Construction Status"; }
getParameterValueByName_4 = Element.GetParameterValueByName(element=watch_2, parameterName=code_block_5)

# group: Add a Header to Each List of Parameter Values
content_header = StringInput("Category")  # graph input
addItemToFront = List.AddItemToFront(item=content_header, list=getCategory)
content_header_2 = StringInput("Family Name")  # graph input
addItemToFront_2 = List.AddItemToFront(item=content_header_2, list=name)
content_header_3 = StringInput("Element ID")  # graph input
addItemToFront_3 = List.AddItemToFront(item=content_header_3, list=id)
content_header_4 = StringInput("IfcGUID")  # graph input
addItemToFront_4 = List.AddItemToFront(item=content_header_4, list=uniqueId)
content_header_5 = StringInput("Surface")  # graph input
addItemToFront_5 = List.AddItemToFront(item=content_header_5, list=getParameterValueByName)
content_header_6 = StringInput("Manhours")  # graph input
addItemToFront_6 = List.AddItemToFront(item=content_header_6, list=getParameterValueByName_2)
content_header_7 = StringInput("Progress")  # graph input
addItemToFront_7 = List.AddItemToFront(item=content_header_7, list=getParameterValueByName_3)
content_header_8 = StringInput("Status")  # graph input
addItemToFront_8 = List.AddItemToFront(item=content_header_8, list=getParameterValueByName_4)
content_header_9 = StringInput("Instance Type")  # graph input
addItemToFront_9 = List.AddItemToFront(item=content_header_9, list=watch_2)

# group: Add Lists Together and Transpose from Horizontal to Vertical
create = List.Create(item0=addItemToFront, item1=addItemToFront_2, item2=addItemToFront_3, item3=addItemToFront_4, item4=addItemToFront_5, item5=addItemToFront_6, item6=addItemToFront_7, item7=addItemToFront_8)
transpose = List.Transpose(lists=create)
watch_3 = Watch(transpose)

# group: Write Data to Excel Document
code_block_6 = CodeBlock { 0; 0; }
boolean = BoolSelector(true)  # graph input
exportExcel = Data.ExportExcel(filePath=file_path, sheetName=worksheet_name_can_be_new, startRow=code_block_6.out0, startCol=code_block_6.out1, data=watch_3, overWrite=boolean)
watch_4 = Watch(exportExcel)

# group: Open excel file and read data
file_path_2 = Filename(".\ProgressInfoImport.xlsx")
file_from_path = FileObject(path=file_path_2)
string = StringInput("Progress Report")
boolean_2 = BoolSelector(true)
importExcel = Data.ImportExcel(file=file_from_path, sheetName=string, showExcel=boolean_2)

# group: Create the List of attributes and removes the titles
list_create_2 = List.Create(item0=importExcel)
transpose_2 = List.Transpose(lists=list_create_2)
code_block_7 = CodeBlock { 1; }
flatten_2 = List.Flatten(list=transpose_2, amt=code_block_7)
restOfItems = List.RestOfItems(list=flatten_2)

# group: Splits the main list into parameters lists
element_id_index = CodeBlock { 1; }
elements_id_list = List.GetItemAtIndex(list=restOfItems@L2, index=element_id_index)
code_block_8 = CodeBlock { 1; }
flatten_3 = List.Flatten(list=elements_id_list, amt=code_block_8)
toString = Custom[Springs.Number.ToString](num=flatten_3)  # Converts the input number(s) to string. Can process lists.
byElementId = archilab.Revit.Selection.Select.ByElementId(id=toString)
std_mhrs_index = CodeBlock { 4; }
standard_manhours_list = List.GetItemAtIndex(list=restOfItems@L2, index=std_mhrs_index)
progress_index = CodeBlock { 5; }
progress_list = List.GetItemAtIndex(list=restOfItems@L2, index=progress_index)
status_index = CodeBlock { 10; }
status_list = List.GetItemAtIndex(list=restOfItems@L2, index=status_index)

# group: set the parameters of each item from excel progress file
string_2 = StringInput("Standard Manhours")
setParameterByName = Element.SetParameterByName(element=byElementId, parameterName=string_2, value=standard_manhours_list)
string_3 = StringInput("Construction Progress")
setParameterByName_2 = Element.SetParameterByName(element=byElementId, parameterName=string_3, value=progress_list)
string_4 = StringInput("Construction Status")
setParameterByName_3 = Element.SetParameterByName(element=byElementId, parameterName=string_4, value=status_list)

# group: To activate only to reset the Construction Status 3D View
views = Views(index=12)
resetElementOverrides = Custom[View.ResetElementOverrides](element=byElementId, view=views)  # frozen; Resets all overrides for an element in a given view
watch_5 = Watch(resetElementOverrides.success)

getParameterValueByName_5 = Element.GetParameterValueByName(element=setParameterByName_3, parameterName=string_4)

# group: Visualize construction Status
string_5 = StringInput("Not Started")
contains = String.Contains(str=getParameterValueByName_5, searchFor=string_5)
filterByBoolMask = List.FilterByBoolMask(list=setParameterByName_3, mask=contains)
color_palette = ColorPalette({R: 255, G: 0, B: 0, A: 255})
color_palette_2 = ColorPalette({R: 0, G: 0, B: 0, A: 255})
fill_patterns = FillPatterns()  # nothing selected
number_slider = DoubleSlider(51, range=1..100 step 1)
byProperties = Revit.Filter.OverrideGraphicSettings.ByProperties(cutFillColor=color_palette, projectionFillColor=color_palette, projectionLineColor=color_palette_2, cutFillPattern=fill_patterns, projectionFillPattern=fill_patterns, transparency=number_slider)
overrideInView = Element.OverrideInView(element=filterByBoolMask.in, overrides=byProperties)
string_6 = StringInput("On Going")
contains_2 = String.Contains(str=getParameterValueByName_5, searchFor=string_6)
filterByBoolMask_2 = List.FilterByBoolMask(list=setParameterByName_3, mask=contains_2)
color_palette_3 = ColorPalette({R: 235, G: 191, B: 10, A: 255})
byProperties_2 = Revit.Filter.OverrideGraphicSettings.ByProperties(cutFillColor=color_palette_3, projectionFillColor=color_palette_3, projectionLineColor=color_palette_2, cutFillPattern=fill_patterns, projectionFillPattern=fill_patterns)
overrideInView_2 = Element.OverrideInView(element=filterByBoolMask_2.in, overrides=byProperties_2)
# note: this section splits the list of elements into the different value of the paramenter "Contstuction status" and gives the geometry a different color
string_7 = StringInput("Completed")
contains_3 = String.Contains(str=getParameterValueByName_5, searchFor=string_7)
filterByBoolMask_3 = List.FilterByBoolMask(list=setParameterByName_3, mask=contains_3)
color_palette_4 = ColorPalette({R: 173, G: 255, B: 47, A: 255})
byProperties_3 = Revit.Filter.OverrideGraphicSettings.ByProperties(cutFillColor=color_palette_4, projectionFillColor=color_palette_4, projectionLineColor=color_palette_2, cutFillPattern=fill_patterns, projectionFillPattern=fill_patterns)
overrideInView_3 = Element.OverrideInView(element=filterByBoolMask_3.in, overrides=byProperties_3)
