# Dynamo graph QA_Modelos.dyn "Q&A_Modelos" (Dynamo 2.12.0.5650)

# group: User Selection
categories = Categories("OST_Walls")  # graph input
all_elements_of_category = ElementsOfCategory(Category=categories)
all_elements_in_active_view = ElementsInView()
select_model_element = DSModelElementSelection()  # 1 picked in the model
file_path = Filename(".\P02-TMSA-TM1-PE-M3D-STR-00.00.rvt")  # graph input

watch = Watch(all_elements_in_active_view)
geometry = Element.Geometry(element=watch)

# group: Classificação Uniclass
elementType = Element.ElementType(element=watch)
parameters = Element.Parameters(element=elementType)
parameter_name = CodeBlock()
# ---------- parameter_name.designscript (6 lines) ----------
"Classification.Uniclass.EF.Number";
"Classification.Uniclass.EF.Description";
"Classification.Uniclass.Ss.Number";
"Classification.Uniclass.Ss.Description";
"Classification.Uniclass.Pr.Number";
"Classification.Uniclass.Pr.Description";
# ----------------------------------------
getParameterValueByName = Element.GetParameterValueByName(element=elementType, parameterName=parameter_name.out0)
code_block = CodeBlock(t1=parameter_name.out0, t2=getParameterValueByName) { t3 = List.AddItemToFront(t1, t2); }
getParameterValueByName_2 = Element.GetParameterValueByName(element=elementType, parameterName=parameter_name.out1)
code_block_2 = CodeBlock(t1=parameter_name.out1, t2=getParameterValueByName_2) { t3 = List.AddItemToFront(t1, t2); }
getParameterValueByName_3 = Element.GetParameterValueByName(element=elementType, parameterName=parameter_name.out2)
code_block_3 = CodeBlock(t1=parameter_name.out2, t2=getParameterValueByName_3) { t3 = List.AddItemToFront(t1, t2); }
getParameterValueByName_4 = Element.GetParameterValueByName(element=elementType, parameterName=parameter_name.out3)
code_block_4 = CodeBlock(t1=parameter_name.out3, t2=getParameterValueByName_4) { t3 = List.AddItemToFront(t1, t2); }
getParameterValueByName_5 = Element.GetParameterValueByName(element=elementType, parameterName=parameter_name.out4)
code_block_5 = CodeBlock(t1=parameter_name.out4, t2=getParameterValueByName_5) { t3 = List.AddItemToFront(t1, t2); }
getParameterValueByName_6 = Element.GetParameterValueByName(element=elementType, parameterName=parameter_name.out5)
code_block_6 = CodeBlock(t1=parameter_name.out5, t2=getParameterValueByName_6) { t3 = List.AddItemToFront(t1, t2); }

# group: File Name
current = Document.Current()
filePath = Document.FilePath(document=current)
code_block_7 = CodeBlock { "\\"; }
split = String.Split(string=filePath, separator0=code_block_7)
lastItem = List.LastItem(list=split)
code_block_8 = CodeBlock { 1; 28; }
substring = String.Substring(string=lastItem, startIndex=code_block_8.out0, length=code_block_8.out1)

# group: Element Ids
uniqueId = Element.UniqueId(element=watch)
code_block_9 = CodeBlock(category1=uniqueId) { t1 = "Element UniqueId"; t2 = List.AddItemToFront(t1, category1); }
id = Element.Id(element=watch)
watch_2 = Watch(id)
code_block_10 = CodeBlock(category1=watch_2) { t1 = "Element Id"; t2 = List.AddItemToFront(t1, category1); }

# group: Categoria, Family, Type
getCategory = Element.GetCategory(element=watch)
code_block_11 = CodeBlock(category1=getCategory) { t1 = "Category"; t2 = List.AddItemToFront(t1, category1); }
parameter_name_2 = StringInput("Family")  # graph input
getParameterValueByName_7 = Element.GetParameterValueByName(element=watch, parameterName=parameter_name_2)
familyName = ElementType.FamilyName(elementType=getParameterValueByName_7)
code_block_12 = CodeBlock(t2=familyName) { t1 = "Family Name"; t3 = List.AddItemToFront(t1, t2); }
name = ElementType.Name(elementType=getParameterValueByName_7)
code_block_13 = CodeBlock(t2=name) { t1 = "Family Type"; t3 = List.AddItemToFront(t1, t2); }

parameter_name_3 = CodeBlock { "Base Constraint"; "Top Constraint"; "Reference Level"; }
getParameterValueByName_8 = Element.GetParameterValueByName(element=watch, parameterName=parameter_name_3.out0)
code_block_14 = CodeBlock(t1=parameter_name_3.out0, t2=getParameterValueByName_8) { t3 = List.AddItemToFront(t1, t2); }
getParameterValueByName_9 = Element.GetParameterValueByName(element=watch, parameterName=parameter_name_3.out1)
code_block_15 = CodeBlock(t1=parameter_name_3.out1, t2=getParameterValueByName_9) { t3 = List.AddItemToFront(t1, t2); }
getParameterValueByName_10 = Element.GetParameterValueByName(element=watch, parameterName=parameter_name_3.out2)
code_block_16 = CodeBlock(t1=parameter_name_3.out2, t2=getParameterValueByName_10) { t3 = List.AddItemToFront(t1, t2); }
parameter_name_4 = CodeBlock { "Phase Created"; "Phase Demolished"; "Auxiliar"; "Incerteza"; }
getParameterValueByName_11 = Element.GetParameterValueByName(element=watch, parameterName=parameter_name_4.out0)
code_block_17 = CodeBlock(t1=parameter_name_4.out0, t2=getParameterValueByName_11) { t3 = List.AddItemToFront(t1, t2); }
getParameterValueByName_12 = Element.GetParameterValueByName(element=watch, parameterName=parameter_name_4.out1)
code_block_18 = CodeBlock(t1=parameter_name_4.out1, t2=getParameterValueByName_12) { t3 = List.AddItemToFront(t1, t2); }
getParameterValueByName_13 = Element.GetParameterValueByName(element=watch, parameterName=parameter_name_4.out2)
code_block_19 = CodeBlock(t1=parameter_name_4.out2, t2=getParameterValueByName_13) { t3 = List.AddItemToFront(t1, t2); }
getParameterValueByName_14 = Element.GetParameterValueByName(element=watch, parameterName=parameter_name_4.out3)
code_block_20 = CodeBlock(t1=parameter_name_4.out3, t2=getParameterValueByName_14) { t3 = List.AddItemToFront(t1, t2); }

# group: Add Lists Together and Transpose from Horizontal to Vertical
create = List.Create(item0=code_block_9.t2, item1=code_block_10.t2, item2=code_block_11.t2, item3=code_block_12.t3, item4=code_block_13.t3, item5=code_block, item6=code_block_2, item7=code_block_3, item8=code_block_4, item9=code_block_5, item10=code_block_6, item11=code_block_14, item12=code_block_15, item13=code_block_16, item14=code_block_17, item15=code_block_18, item16=code_block_19, item17=code_block_20)
transpose = List.Transpose(lists=create)

watch_3 = Watch(transpose)
boolean = BoolSelector(false)  # graph input

# group: Element Data
code_block_21 = CodeBlock { 5; 0; }
boolean_2 = BoolSelector(true)  # graph input
exportToExcel = Data.ExportToExcel(filePath=file_path, sheetName=substring, startRow=code_block_21.out0, startColumn=code_block_21.out1, data=watch_3, overWrite=boolean, writeAsString=boolean_2)

basePoint = Coordinates.BasePoint()
getWarnings = Warning.GetWarnings(document=current)
count = List.Count(list=getWarnings)
list_create = List.Create(item0=basePoint, item1=count)

# group: Geolocation, Warnings
code_block_22 = CodeBlock { 1; 1; }
boolean_3 = BoolSelector(false)  # graph input
boolean_4 = BoolSelector(true)  # graph input
exportToExcel_2 = Data.ExportToExcel(filePath=file_path, sheetName=substring, startRow=code_block_22.out0, startColumn=code_block_22.out1, data=list_create, overWrite=boolean_3, writeAsString=boolean_4)

# group: Project Name
code_block_23 = CodeBlock { 0; 1; }
boolean_5 = BoolSelector(false)  # graph input
boolean_6 = BoolSelector(true)  # graph input
exportToExcel_3 = Data.ExportToExcel(filePath=file_path, sheetName=substring, startRow=code_block_23.out0, startColumn=code_block_23.out1, data=lastItem, overWrite=boolean_5, writeAsString=boolean_6)

parameters_2 = Element.Parameters(element=watch)
