# Dynamo graph Send Parameters to XML.dyn "Parametros Revit para XML _ ID" (Dynamo 2.2.1.5175)

# note: Apanha todos os elementos na View. Podemos usar outros métodos: http://dynamobim.org/forums/topic/get-all-objects-by-parameter/
all_elements_in_active_view = ElementsInView()  # graph input

# group: Apanha uma parede específica, para testes
code_block = CodeBlock { "Length"; }
parameterByName = Parameter.ParameterByName(element=all_elements_in_active_view, name=code_block)
value = Parameter.Value(parameter=parameterByName)
code_block_2 = CodeBlock { 65.5; }
eq = value == code_block_2
filterByBoolMask = List.FilterByBoolMask(list=all_elements_in_active_view, mask=eq)

watch = Watch(all_elements_in_active_view)

# group: Extract Category, Family and Type
code_block_3 = CodeBlock { "Category"; }
code_block_4 = CodeBlock { "Family_and_Type"; }
getParameterValueByName = Element.GetParameterValueByName(element=watch, parameterName=code_block_3)
getParameterValueByName_2 = Element.GetParameterValueByName(element=watch, parameterName=code_block_4)

# group: Extract Base Level and Width
code_block_5 = CodeBlock { "Base_Constraint"; }
code_block_6 = CodeBlock { "Wall_Width"; }
getParameterValueByName_3 = Element.GetParameterValueByName(element=watch, parameterName=code_block_5)
getTotalWidth = Custom[Wall.GetTotalWidth](Walls=watch)  # Get Wall's Total Width parameter

# group: Extract Ids
code_block_7 = CodeBlock { "IfcGUID"; }
code_block_8 = CodeBlock { "Element_Id"; }
code_block_9 = CodeBlock { "Unique_Id"; }
getParameterValueByName_4 = Element.GetParameterValueByName(element=watch, parameterName=code_block_7)
id = Element.Id(element=watch)
uniqueId = Element.UniqueId(element=watch)

# group: Extrai Comment
code_block_10 = CodeBlock { "Comments"; }
parameterByName_2 = Parameter.ParameterByName(element=watch, name=code_block_10)
value_2 = Parameter.Value(parameter=parameterByName_2)
string_from_object = FromObject(obj=value_2)

# group: Assemble data and write XML file
# note: Write Element data to xml file. From: https://forum.dynamobim.com/t/export-to-xml/4424/2
code_block_11 = CodeBlock { "Element"; }
nomes_das_variaveis_list_create = List.Create(item0=code_block_3, item1=code_block_4, item2=code_block_5, item3=code_block_6, item4=code_block_7, item5=code_block_8, item6=code_block_9, item7=code_block_10)
valores_das_variáveis_list = List.Create(item0=getParameterValueByName, item1=getParameterValueByName_2, item2=getParameterValueByName_3, item3=getTotalWidth, item4=getParameterValueByName_4, item5=id, item6=uniqueId, item7=string_from_object)  # "Valores das Variáveis(List.Create)"
transpose = List.Transpose(lists=valores_das_variáveis_list)
createDataTable = Lists.DataSets.CreateDataTable(Name=code_block_11, Headers=nomes_das_variaveis_list_create, Data=transpose)
createDataSet = Lists.DataSets.CreateDataSet(Name=code_block_11, Tables=createDataTable)
code_block_12 = CodeBlock { true; }
file_path = Filename(".\Element_Id_Wall_Thickness.xml")
serializeXML = Lists.DataSets.SerializeXML(Data=createDataSet, SaveBool=code_block_12, FilePath=file_path)
watch_2 = Watch(serializeXML)
