# Dynamo graph Verifica Classificacao.dyn (Dynamo 2.3.0.5885)
# packages: Clockwork for Dynamo 2.x 2.3.0, archi-lab.net 2020.23.7

# group: Restaura elementos escondidos na vista
current = Document.Current()
activeView = Document.ActiveView(document=current)
the_view_dynamo_considers_active = Watch(activeView)
disableTemporaryHideIsolate = Custom[View.DisableTemporaryHideIsolate](view=the_view_dynamo_considers_active)  # package Clockwork for Dynamo 2.x; Disables the temporary hide/isolate for the given view (if set)

# group: Selecciona Elementos Não-Classificados
all_elements_in_active_view = ElementsInView()
code_block = CodeBlock { "Classification.Uniclass.EF.Number"; "Classification.Uniclass.EF.Description"; }

watch = Watch(all_elements_in_active_view)

# group (continued): Selecciona Elementos Não-Classificados
elementType = Element.ElementType(element=watch)
getParameterValueByName = Element.GetParameterValueByName(element=elementType, parameterName=code_block.out0)
getParameterValueByName_2 = Element.GetParameterValueByName(element=elementType, parameterName=code_block.out1)
# note: "Esta rotina analisa os elementos seleccionados na vista, verifica se estão classificados (parametro type Classification.Uniclass.EF.Number preenchido) e esconde todos os elementos classificados"
# Atenção que não verifica se a classificação está de acordo com o sistema de classificação.
length_of_the_classification_and = CodeBlock(ClassifNumber=getParameterValueByName, ClassifDesc=getParameterValueByName_2)  # "Length of the classification and description is large (+"" converts parameter to string)"
# ---------- length_of_the_classification_and.designscript (3 lines) ----------
ClassifNumberLenght = String.Length(ClassifNumber+"");
ClassifDescLenght = String.Length(ClassifDesc+"");
ClassifNumberLenght > 4 && ClassifDescLenght > 4;
# ----------------------------------------
filterByBoolMask = List.FilterByBoolMask(list=watch, mask=length_of_the_classification_and.out2)

# group: Esconde Elementos Classificados
temporarilyIsolateElement = Custom[View.TemporarilyIsolateElement](view=disableTemporaryHideIsolate.view, element=filterByBoolMask.in)  # package Clockwork for Dynamo 2.x; Temporarily isolates elements in the given view
watch_2 = Watch(temporarilyIsolateElement.success)

# group: Sucess dialog box
code_block_2 = CodeBlock()
# ---------- code_block_2.designscript (2 lines) ----------
"Os elementos da vista \n";
"\n com os Type Parameter \n 'Classification.Uniclass.EF.Number' e \n'Classification.Uniclass.EF.Description' \n preenchidos foram escondidos";
# ----------------------------------------
watch_3 = Watch(activeView)
code_block_3 = CodeBlock(msg1=code_block_2.out0, Vista=watch_3, msg2=code_block_2.out1) { msg1+Vista+msg2; }
python_script = Python(IN[0]=watch_2, IN[1]=code_block_3)
# ---------- python_script.python (15 lines) ----------
import clr
import msvcrt

clr.AddReference("RevitAPIUI")
from  Autodesk.Revit.UI import *

button = TaskDialogCommonButtons.None
result = TaskDialogResult.Ok
if IN[0] == True:
	TaskDialog.Show('User Text',IN[1],button)
	result = IN[1]
else:
	result = "Set run to true"
		
OUT = result
# ----------------------------------------

# group: Só para ver o que está em cada conjunto
type = archilab.Revit.Elements.Elements.Type(element=filterByBoolMask.out)
sem_number_ou_sem_descriçao = Watch(type)
type_2 = archilab.Revit.Elements.Elements.Type(element=filterByBoolMask.in)
com_number_e_desc = Watch(type_2)

watch_4 = Watch(code_block_3)
