# Dynamo graph Volume Caboucos e Betao Limpeza.dyn "Volume_Caboucos" (Dynamo 2.5.0.7460)

# group: Cota da Topografia
levels = Levels("Level 0")
elevation = Level.Elevation(level=levels)
select_model_element = DSModelElementSelection()  # 1 picked in the model
code_block = CodeBlock { "Thickness"; }
getParameterValueByName = Element.GetParameterValueByName(element=select_model_element, parameterName=code_block)
code_block_2 = CodeBlock(terreno=elevation, laje=getParameterValueByName) { terreno-laje; }

sub = elevation - getParameterValueByName

# group: Fundações
code_block_3 = CodeBlock { "Structural Foundations"; }  # frozen
byName = Category.ByName(name=code_block_3)
all_elements_of_category = ElementsOfCategory(Category=byName)

# group: Profundidade de Escavação
code_block_4 = CodeBlock { "Elevation at Bottom"; }
getParameterValueByName_2 = Element.GetParameterValueByName(element=all_elements_of_category, parameterName=code_block_4)
altura_a_escavar = code_block_2 - getParameterValueByName_2

# group: Filtra Volumes Negativos
code_block_5 = CodeBlock { 0; }
lt = altura_a_escavar < code_block_5
filterByBoolMask = List.FilterByBoolMask(list=all_elements_of_category, mask=lt)
sapatas_enterradas_watch = Watch(filterByBoolMask.out)

sapatas_voadoras = Watch(filterByBoolMask.in)
filterByBoolMask_2 = List.FilterByBoolMask(list=altura_a_escavar, mask=lt)

# group (continued): Filtra Volumes Negativos
profundidades_positivas_watch = Watch(filterByBoolMask_2.out)

code_block_6 = CodeBlock { "Area"; }
getParameterValueByName_3 = Element.GetParameterValueByName(element=sapatas_enterradas_watch, parameterName=code_block_6)
code_block_7 = CodeBlock(ProfEscavacao=profundidades_positivas_watch, AreaFundacao=getParameterValueByName_3) { ProfEscavacao*AreaFundacao; }
sum = Math.Sum(values=code_block_7)
selecionar_laje_terrea_select = DSModelElementSelection()  # "Selecionar Laje TErrea (Select Model Element)"; 1 picked in the model
code_block_8 = CodeBlock { "Elevation at Bottom"; }
getParameterValueByName_4 = Element.GetParameterValueByName(element=selecionar_laje_terrea_select, parameterName=code_block_8)
select_model_elements = DSModelElementsSelection()  # 12 picked in the model
code_block_9 = CodeBlock { "Structural Foundations"; }
getCategory = Element.GetCategory(element=select_model_elements)
string_from_object = FromObject(obj=getCategory)
eq = code_block_9 == string_from_object
filterByBoolMask_3 = List.FilterByBoolMask(list=select_model_elements, mask=eq)
watch = Watch(filterByBoolMask_3.in)
faces = Element.Faces(element=watch)
number_slider = DoubleSlider(0.4, range=0..1 step 0.1)
pointAtParameter = Surface.PointAtParameter(surface=faces, u=number_slider, v=number_slider)
normalAtPoint = Surface.NormalAtPoint(surface=faces, point=pointAtParameter)
Z = Vector.Z(vector=normalAtPoint)
code_block_10 = CodeBlock { -0.95; }
le = Z <= code_block_10
filterByBoolMask_4 = List.FilterByBoolMask(list=faces, mask=le)
flatten = List.Flatten(list=filterByBoolMask_4.in)
watch_2 = Watch(flatten)
perimeterCurves = Surface.PerimeterCurves(surface=watch_2)
floor_types = FloorTypes("Betao_Limpeza_100")
code_block_11 = CodeBlock { "Level"; }
getParameterValueByName_5 = Element.GetParameterValueByName(element=watch, parameterName=code_block_11)
byOutlineTypeAndLevel = Floor.ByOutlineTypeAndLevel(outline=perimeterCurves, floorType=floor_types, level=getParameterValueByName_5)
string = StringInput("")
