# Dynamo graph WorkshopPTBIM2024.dyn (Dynamo 3.0.3.7597)

# group: 1 - Ligar as Fontes de Dados

# group: 2 - Transformar, converter e integrar informação

# group: 3 - Partilhar informação

# group: Apanha Excel Categorias + Unidades e faz Dicionário de Unidades
# note: O ficheiro que tem a lista das categorias: "Revit Categories + QTO Units.xlsx"
file_path = Filename("No file selected.")
file_from_path = FileObject(path=file_path)
code_block = CodeBlock { "Structural Elements"; "Steel Elements"; }
importExcel = Data.ImportExcel(file=file_from_path, sheetName=code_block.out0)
restOfItems = List.RestOfItems(list=importExcel)
transpose = List.Transpose(lists=restOfItems)
code_block_2 = CodeBlock(a=transpose) { a[0]; a[1]; a[2]; }
categorias = Watch(code_block_2.out0)
parametro_de_medicao = Watch(code_block_2.out1)
# note: Este Dicionário relaciona Categorias e Unidades de Medição.
byKeysValues = DesignScript.Builtin.Dictionary.ByKeysValues(keys=categorias, values=parametro_de_medicao)

# group: Apanha todos os Elementos das Categorias Selecionadas
byName = Category.ByName(name=categorias)
all_elements_of_category = ElementsOfCategory(Category=byName)
flatten = List.Flatten(list=all_elements_of_category)

elementos = Watch(flatten)

# group: Apanha Quantidades de Acordo com Unidades
getCategory = Element.GetCategory(element=flatten)
string_from_object = FromObject(object=getCategory)
# note: Determinamos a unidade de medição de cada Elemento, de acordo com a sua Categoria.
valueAtKey = DesignScript.Builtin.Dictionary.ValueAtKey(dictionary=byKeysValues, key=string_from_object)
parameterByName = Parameter.ParameterByName(element=elementos, name=valueAtKey)
value = Parameter.Value(parameter=parameterByName)
quantidade = Watch(value)

# group: Apanha Fase de cada Elemento
code_block_3 = CodeBlock { "Phase Created"; }
parameterByName_2 = Parameter.ParameterByName(element=elementos, name=code_block_3)
string_from_object_2 = FromObject(object=parameterByName_2)
# note: Extrai o nome da fase, retirando o início da string
code_block_4 = CodeBlock { ": "; }
split = String.Split(string=string_from_object_2, separator0=code_block_4)
lastItem = List.LastItem(list=split, lacing=Longest)
fase = Watch(lastItem)
# note: Alternativa com Python Script node gerado com ChatGPT
# Como foi gerado este código.
# "In revit dynamo i have a list of strings that start with "Phase Created : " and then have a phase name. How do I get just the phase name?"
python_script = Python(IN[0]=string_from_object_2)  # CPython3
# ---------- python_script.python (25 lines) ----------
# Importa o módulo Revit
import clr

# Importa o módulo DocumentManager do Dynamo RevitServices
clr.AddReference("RevitServices")
from RevitServices.Persistence import DocumentManager

# Obtém o documento atual do Revit
doc = DocumentManager.Instance.CurrentDBDocument



# Recebe a lista de textos do exterior
lista_textos = IN[0]

# Lista para armazenar os textos relevantes
textos_interessantes = []
# Itera sobre cada texto na lista
for texto in lista_textos:
    # Extrai o texto relevante após "Phase Created :"
    texto_interessante = texto.split(":")[1].strip()
    # Adiciona o texto relevante à lista
    textos_interessantes.append(texto_interessante)

OUT = textos_interessantes
# ----------------------------------------

# group: Calcula Totais de Quantidades das Fases
groupByKey = List.GroupByKey(list=quantidade, keys=fase)
watch = Watch(groupByKey.uniqueKeys)
# note: Também aqui pedi ajuda ao ChatGPT:
# !In revit dynamo i have a list of element construction phases and a list of quantities. Hou do I get the total quantity of each phase?"
# Ele sugeriu o List.GroupByKey e o List.Map, dois nós muito úteis e de que poucas vezes me recordo.
sum = Math.Sum()  # unwired: values
map = List.Map(list=groupByKey.groups, function=sum)

# group: Cria Tabela e Manda para o Excel
# note: Escolher onde vai ser gravado o Excel
file_path_2 = Filename(".\Tower_structurall_phases_Sapatas.xlsx")
code_block_5 = CodeBlock { "Sheet1"; 0; 1; }
cabeçalho = CodeBlock { ["Fase","Quantidade","Unidade"]; }
list_create = List.Create(item0=watch, item1=map)
transpose_2 = List.Transpose(lists=list_create)
addItemToFront = List.AddItemToFront(item=cabeçalho, list=transpose_2)
exportToExcel = Data.ExportToExcel(filePath=file_path_2, sheetName=code_block_5.out0, startRow=code_block_5.out1, startColumn=code_block_5.out1, data=addItemToFront, overWrite=code_block_5.out2)
